% Simulink data dictionary modelDesignData_Galvo_sys_Ccont_Pcont.sldd

param = struct(
  JR="6e-8",
  KMT="9.3e-3",
  Rc="3.5",
  Lc="170e-6",
  KFR="4e-12",
  KTB="1e-9",
  KBM="170e-6/(pi/180)",
  Rsh="15e-3",
  KPOS1="0.172")

paramCtrl = struct(I_LIM="20", Kbc="1e-5", Kp_cc="25", KshM="50", dummy="0")

KEMF = Simulink.Parameter(0.00974, Unit="Vs/rad")  % Back-EMF voltage const.
  % 0.17mV/degree/sec = 9.74mV/rad/s
  % Tolerance +-10%

Lc = Simulink.Parameter(0.00016, Unit="Henry")  % Coil inductance, 160uH
  % Tolerance: +-10%

KEL = Simulink.Parameter(0.0093, Unit="Nm/A")  % el. Torque constant
  % 9.3e4 dyne.cm/A = 9.3e-3 Nm/A
  % Tolerance: +-10%

RL = Simulink.Parameter(1.5, Unit="Ohm")  % Coil resistance
  % 1.5Ohm
  % Tolerance: +-10%

JR = Simulink.Parameter(6.0e-8, Unit="kg.m^2")  % Rotor inertia, Massenträgheit der Rotorwelle
  % 0.6 gm.cm^2 = 6e-8 kg.m^2
  % Tolerance: +-10%

dPosMax = Simulink.Parameter(0.6981317, Unit="rad")  % Max. angular excursion value:
  % deltaPhi_max = 40° = .698rad
  % +-20° from zero position

KSH = Simulink.Parameter(25, Unit="V/V")  % Current shunt monitor gain
  % LTC2050HV hat evtl. nicht genug
  % Bandbreite:  GBWP: A0*fg/ft=1
  % -> fg=3MHz/100=30kHz
  % Zur Sicherheit zwei Stufen mit je 20dB verbaut
  % * Input Offset Voltage:  3μV (max)  500nV (typ)
  % * Input Offset Voltage Drift:  30nV/°C (max)
  % * Noise: 1.5μVP-P (0.01Hz to 10Hz Typ)
  % * Voltage Gain: 140dB (Typ)
  % * PSRR: 130dB (Typ)
  % * CMRR: 130dB (Typ)

ADCres = Simulink.Parameter(12, DataType="int8", Unit="bit")  % ADC resolution in bit
ccKp = Simulink.Parameter(85.68065)  % Continuous current compensator proportional gain

KFR = Simulink.Parameter(1.0e-10, Unit="Nm.s/rad")  % Mechanic friction torque constant
  % Keine Herstellerangaben, Reibungsverluste von Kugellager und Pos. Sensor

KTB = Simulink.Parameter(1.0e-9, Unit="Nm/rad")  % Torsion bar torque constant
  % Keine Herstellerangabe, aber experimentell nachweisbar

Rsh = Simulink.Parameter(0.075, Unit="Ohm")  % Current shunt value

KPOS = Simulink.Parameter([9.8549 28.648], Unit="V/rad")  % Angular position demodulator circuit gain;
  % Galvo-HW#1:
  % 0.172V/° = 9.8549V/rad --> +-.5*dPosMax*9.8549V/rad=
  % 0.5V/° = 28.648V/rad
  % 28-04-2015
  % Galvo #1 ausgemessen:
  % KPOS1: 0.172 V/deg
  % -+45° ->  -7.9V...7.6V
  % signed wDeg * 2^11/40° = wZdeg=51.2dig
  % (+-20° anstatt +-45°, besseres
  % linear-Verhalten)

FS_ = Simulink.Parameter(2.0e-6, Unit="sec")  % Sample rate for dicrete components
FS = 2.0e-6