% Simulink data dictionary dataDict_galvoMod6860.sldd
% references dataDict_galvoSystemParams.sldd

dPosMax = Simulink.Parameter(0.6981317, Unit="rad")  % Max. angular excursion value:
  % deltaPhi_max = 40° = .698rad
  % +-20° from zero position

JR = Simulink.Parameter(6.0e-8, Unit="kg.m^2")  % Rotor inertia, Massenträgheit der Rotorwelle
  % 0.6 gm.cm^2 = 6e-8 kg.m^2
  % Tolerance: +-10%

KEL = Simulink.Parameter(0.0093, Unit="Nm/A")  % el. Torque constant
  % 9.3e4 dyne.cm/A = 9.3e-3 Nm/A
  % Tolerance: +-10%

KEMF = Simulink.Parameter(0.00974, Unit="Vs/rad")  % Back-EMF voltage const.
  % 0.17mV/degree/sec = 9.74mV/rad/s
  % Tolerance +-10%

KFR = Simulink.Parameter(1.0e-10, Unit="Nm.s/rad")  % Mechanic friction torque constant
  % Keine Herstellerangaben, Reibungsverluste von Kugellager und Pos. Sensor

L = Simulink.Parameter(0.00016, Unit="Henry")  % Coil inductance, 160uH
  % Tolerance: +-10%

RL = Simulink.Parameter(1.5, Unit="Ohm")  % Coil resistance
  % 1.5Ohm
  % Tolerance: +-10%

Description = "This data dict holds physical parameters of Cambridge Tech Galvoscanner model 6860"

KTB = Simulink.Parameter(1.0e-9, Unit="Nm/rad")  % Torsion bar torque constant
  % Keine Herstellerangabe, experimentell ermitteln;
  % In PHD_LSK040EF ist KTB=47e-3 Nm/rad.
  % PHD full: page 40/106:
  % ... With such assumptions the torsion bar constant KTR can
  % be measured by determining torque needed to hold given
  % rotor position (out of neutral of course).
  % KTBmess=KEL*iL_40Deg/dPosMax

KTBmess = Simulink.Parameter(0.03197104, Unit="Nm/rad")  % Torsion bar torque constant
  % Keine Herstellerangabe, experimentell ermitteln;
  % In PHD_LSK040EF ist KTB=47e-3 Nm/rad.
  % PHD full: page 40/106:
  % ... With such assumptions the torsion bar constant KTR can
  % be measured by determining torque needed to hold given
  % rotor position (out of neutral of course).
  % KTBmess=KEL*iL_40Deg/dPosMax