% Simulink data dictionary dataDict_galvoSystemParams.sldd

KPD = Simulink.Parameter([9.8549 28.648], Unit="V/rad")  % Angular position demodulator circuit gain;
  % Galvo-HW#1:
  % 0.172V/° = 9.8549V/rad --> +-.5*dPosMax*9.8549V/rad=
  % 0.5V/° = 28.648V/rad
  % 28-04-2015
  % Galvo #1 ausgemessen:
  % KPOS1: 0.172 V/deg
  % -+45° ->  -7.9V...7.6V
  % signed wDeg * 2^11/40° = wZdeg=51.2dig
  % (+-20° anstatt +-45°, besseres
  % linear-Verhalten)

KSH = Simulink.Parameter(25, Unit="V/V")  % Current shunt monitor gain
  % LTC2050HV hat evtl. nicht genug
  % Bandbreite:  GBWP: A0*fg/ft=1
  % -> fg=3MHz/100=30kHz
  % Zur Sicherheit zwei Stufen mit je 20dB verbaut
  % * Input Offset Voltage:  3μV (max)  500nV (typ)
  % * Input Offset Voltage Drift:  30nV/°C (max)
  % * Noise: 1.5μVP-P (0.01Hz to 10Hz Typ)
  % * Voltage Gain: 140dB (Typ)
  % * PSRR: 130dB (Typ)
  % * CMRR: 130dB (Typ)

Rsh = Simulink.Parameter(0.075, Unit="Ohm")  % Current shunt value
FS = 2.0e-6
ccKp = Simulink.Parameter(85.68065)  % Continuous current compensator proportional gain
ADCres = Simulink.Parameter(12, DataType="int8", Unit="bit")  % ADC resolution in bit
DescriptionSys = "This data dict holds physical parameters of galvo hardware"